# Grasshopper definition test.gh (Grasshopper 1.0.7)
# plug-ins: Kangaroo Components, EleFront

# ----
# input Curves in order.
# Curves must be in the same direction
crv = Curve([<curve referenced from the Rhino model> x3])  # disabled

# ----
# input odd number
# this shows number of lines to generate
number_slider = Slider(33, range=0..100)  # disabled

# ----
# Parameters
number_slider_2 = Slider(0.1, range=0..1)  # disabled
number_slider_3 = Slider(81, range=1..100)  # disabled
number_slider_4 = Slider(2, range=0..2)  # disabled
number_slider_5 = Slider(7, range=0..32.5)  # disabled
number_slider_6 = Slider(1.2, range=0..2)  # disabled
number_slider_7 = Slider(23.781, range=0..80)  # disabled
number_slider_8 = Slider(0.213, range=0..0.4)  # disabled
number_slider_9 = Slider(1, range=-1..1)  # disabled
number_slider_10 = Slider(1, range=0..1)  # disabled
number_slider_11 = Slider(0, range=-2..2)  # disabled
number_slider_12 = Slider(0.2, range=-0.2..0.2)  # disabled
number_slider_13 = Slider(5, range=0..8)  # disabled

loft = Loft(Curves=crv, Options={Adjust=False, Closed=False, LoftEnds=0, LoftSimp=0, LoftType=0, Rebuild=10, Refit=0.01})  # disabled
subtraction = Subtraction(A=number_slider, B=1)  # disabled
one_over_x = OneOverX(Value=subtraction)  # disabled
panel = Panel("""0
1""")  # disabled
number_slider_14 = Slider(0.5, range=0..1)  # disabled
series = Series(Start=0, Step=one_over_x, Count=number_slider)  # disabled
debrep = DeconstructBrep(Brep=loft)  # -> Faces, Edges, Vertices; disabled
pt = ConstructPoint(XCoordinate=0, YCoordinate=panel, ZCoordinate=0)  # disabled
pt_2 = ConstructPoint(XCoordinate=series, YCoordinate=number_slider_14, ZCoordinate=0)  # disabled
button = Button()
iso = IsoCurve(Surface=reparameterize(simplify(graft(debrep.Faces))), UVPoint=pt)  # -> UIsocurve, VIsocurve; disabled
trigger = Trigger(Interval=10, TimerInterval=10, Target=counter)  # disabled
crv_2 = Curve(flatten(iso.UIsocurve))  # disabled
counter = Counter(Reset=button)
c_remvoe_dup_crv = CSharpScript(crv=crv_2)  # -> out, A; inputs crv: list of Curve; disabled
# ---------- c_remvoe_dup_crv: C# ----------
    List<Curve> outputCrv = new List<Curve>();
    for(int i = 0;i < crv.Count;i++){
      Curve c = crv[i];
      if(outputCrv.Count == 0)
      {
        outputCrv.Add(c);
        continue;
        }        
      bool isSame = false;

      foreach(Curve cc in outputCrv){
        if(cc.PointAtStart.DistanceTo(c.PointAtStart) < 0.01&&
        cc.PointAtEnd.DistanceTo(c.PointAtEnd) < 0.01)
        {
          isSame = true;
        }
        else if(cc.PointAtEnd.DistanceTo(c.PointAtStart) < 0.01 &&
        cc.PointAtStart.DistanceTo(c.PointAtEnd) < 0.01){
          isSame = true;
        }
        if(isSame)break;
      }
      if(!isSame)outputCrv.Add(c);
    }
    A = outputCrv;
# ---------- end c_remvoe_dup_crv ----------
item = ListItem(List=crv, Index=0, Wrap=True)  # disabled
panel_2 = Panel("30")
iso_2 = IsoCurve(Surface=reparameterize(graft(debrep.Faces)), UVPoint=pt_2)  # -> UIsocurve, VIsocurve; disabled
ccx = CurveCurve(CurveA=c_remvoe_dup_crv.A, CurveB=item)  # -> flatten(Points), ParamsA, ParamsB; disabled
fram_to_time = FramToTime(frame=counter, fps=Slider(10, range=0..30))  # -> out, time, guid; inputs frame: Double, fps: Int32
# ---------- fram_to_time: C# ----------
    time = frame / fps;
    guid = this.Component.InstanceGuid;
# ---------- end fram_to_time ----------
alongcrv = SortAlongCurve(Points=ccx.Points, Curve=item)  # -> Points, Indices; disabled
graph_mapper = GraphMapper(
    fram_to_time.time,
    x0=0,
    x1=10,
    y0=0,
    y1=1,
    container_name="Bezier",
    cpx=[0, 0.4577114284, 0.6368159056, 1],
    cpy=[0, 0, 1, 1])
dom = ConstructDomain(DomainStart=0, DomainEnd=Slider(19, range=0..100))
crv_3 = Curve(flatten(iso_2.VIsocurve))  # disabled
item_2 = ListItem(List=flatten(iso_2.UIsocurve), Index=0, Wrap=True)  # -> Item1, Item; disabled
number_slider_15 = Slider(2, range=0..100)  # disabled
item_3 = ListItem(List=c_remvoe_dup_crv.A, Index=alongcrv.Indices, Wrap=True)  # disabled
curvepoint = PointOnCurve(item_3, parameter=0.5)  # disabled
remap = RemapNumbers(Value=fram_to_time.time, Source=dom, Target=Domain(0, 1))  # -> Mapped, Clipped
join = JoinCurves(Curves=flatten(crv_3), Preserve=False)  # disabled
crv_4 = Curve(join)  # disabled
crv_5 = Curve(item_2.Item)  # disabled
number_slider_16 = Slider(2, range=0..10)  # disabled
points = PointList(Points=curvepoint, Size=number_slider_15)  # disabled
panel_3 = Panel("0.0 to 1")  # disabled
ccx_2 = CurveCurve(CurveA=crv_4, CurveB=item_2.Item)  # -> Points, ParamsA, ParamsB; disabled
cull_i = CullIndex(List=item_3, Indices=number_slider_16, Wrap=True)  # disabled
alongcrv_2 = SortAlongCurve(Points=flatten(ccx_2.Points), Curve=item_2.Item)  # -> Points, flatten(Indices); disabled
remap_numbers = RemapNumbers(Value=fram_to_time.time, Source=Domain(0, 1), Target=panel_3)  # -> Mapped, Clipped; disabled
number_slider_17 = Slider(0.174, range=0..1)
crv_6 = Curve(item_3)  # disabled
item_4 = ListItem(List=crv_4, Index=alongcrv_2.Indices, Wrap=True)  # disabled
ccx_3 = CurveCurve(CurveA=graft(item_4), CurveB=crv_6)  # -> Points, ParamsA, ParamsB; disabled
eventoperation = EventOperation(events=flatten(remap_numbers.Mapped), time=fram_to_time.time)  # -> out, outValue; inputs events: list of Double, time: Double; disabled
# ---------- eventoperation: C# ----------
    List<double> eventValue = new List<double>();
    List<double> eventStart = new List<double>();
    List<Interval> eventInterval = new List<Interval>();

    for(int i = 0;i < events.Count;i++)
    {
      IGH_DocumentObject gdo = this.Component.Params.Input[0].Sources[i].Attributes.GetTopLevel.DocObject;
      if(gdo.GetType().ToString() == "MathComponents.DomainComponents.Component_RemapNumbers")
      {
        
        IGH_Component gc = (IGH_Component) gdo;
        gc.Params.Input[0].WireDisplay = GH_ParamWireDisplay.hidden;
        IGH_DocumentObject gdo2 = gc.Params.Input[0].Sources[0];
        if(gdo2.GetType().ToString() == "Grasshopper.Kernel.Special.GH_GraphMapper")
        {
          Grasshopper.Kernel.Special.GH_GraphMapper ggm = (Grasshopper.Kernel.Special.GH_GraphMapper) gdo2;
          eventValue.Add(events[i]);
          eventStart.Add(ggm.Container.X0);
          eventInterval.Add(new Interval(ggm.Container.X0, ggm.Container.X1));
        }
      }
    }
    sort(eventStart, eventValue, eventInterval, out eventStart, out eventValue, out eventInterval);

    outValue = GetCurrentValue(time, eventInterval, eventValue);
# ---------- eventoperation: C# additional code ----------
  void sort(List<double> listA, List<double> listB, List<Interval> listC, out List<double> LA_, out List<double> LB_, out List<Interval> LC_)
  {
    List<double> LA = new List<double>();
    List<double> LB = new List<double>();
    List<Interval> LC = new List<Interval>();
    if(listA.Count < 2)
    {
      LA = listA;
      LB = listB;
      LC = listC;
    }
    else
    {
      LA.Add(listA[0]);
      LB.Add(listB[0]);
      LC.Add(listC[0]);
      for(int i = 1;i < listA.Count;i++)
      {
        bool sign = true;
        for(int j = 0;j < LA.Count;j++)
        {
          if(listA[i] < LA[j])
          {
            LA.Insert(j, listA[i]);
            LB.Insert(j, listB[i]);
            LC.Insert(j, listC[i]);
            sign = false;
            break;
          }
        }
        if(sign)
        {
          LA.Add(listA[i]);
          LB.Add(listB[i]);
          LC.Add(listC[i]);
        }
      }
    }

    LA_ = LA;
    LB_ = LB;
    LC_ = LC;
  }

  double GetCurrentValue(double time, List<Interval> eventInterval, List<double> eventValue)
  {
    bool sign = true;
    double currentValue = eventValue[0];
    for(int i = 0;i < eventInterval.Count - 1;i++)
    {
      Interval dom = new Interval(eventInterval[i].T0, eventInterval[i + 1].T0);
      if(dom.IncludesParameter(time, false))
      {
        currentValue = eventValue[i];
        sign = false;
      }
    }
    if(sign)
    {
      if(time >= eventInterval[eventInterval.Count - 1].T0)
      {
        currentValue = eventValue[eventInterval.Count - 1];
      }
    }
    return currentValue;
  }
# ---------- end eventoperation ----------
item_5 = ListItem(List=item_4, Index=0, Wrap=True)  # disabled
pshift = ShiftPaths(Data=ccx_3.ParamsA, Offset=-1)  # -> simplify(Data); disabled
curve = Curve(reparameterize(<curve referenced from the Rhino model>))
shatter = Shatter(Curve=graft(item_4), Parameters=pshift)  # -> simplify(Segments); disabled
panel_4 = Panel(eventoperation.outValue)  # disabled
explode = Explode(Curve=item_4, Recursive=True)  # -> simplify(Segments), Vertices; disabled
fillet = Fillet(Curve=curve, Radius=Slider(100, range=0..100))
flip = FlipCurve(Curve=fillet)  # -> Curve, Flag
curve_2 = Curve(<curve referenced from the Rhino model>)
crv_7 = Curve(simplify(shatter))  # disabled
ghpython_script = GhPythonScript(x=remap.Mapped)  # -> out, a
# ---------- ghpython_script: Python ----------
__author__ = "anshoki"
__version__ = "2021.12.17"

import rhinoscriptsyntax as rs
if x >1:
    x = 1
else:
    x = x
a = x
# ---------- end ghpython_script ----------
reb = RebuildCurve(Curve=fillet, Count=Slider(32, range=0..100), Tangents=False)
evaluate_curve = EvaluateCurve(Curve=reparameterize(reb), Parameter=ghpython_script.a)  # -> Point, Tangent, Angle
evaluate_curve_2 = EvaluateCurve(Curve=reparameterize(curve_2), Parameter=ghpython_script.a)  # -> Point, Tangent, Angle
number_slider_18 = Slider(3.5, range=0..3.5)  # disabled
Z = UnitZ(Factor=1)
toggle = BooleanToggle(True)  # disabled

# ---- group: target
point = Point(evaluate_curve.Point)

# ----
c_create_fins = CSharpScript(
    bp=loft,
    edges=crv_6,
    crvTree=crv_7,
    length=number_slider_7,
    gap=number_slider_9,
    offset=number_slider_6,
    edgeShift=number_slider_5,
    zShift=number_slider_8,
    baseTaperLength=number_slider_13,
    maxRan=number_slider_18,
    midThick=number_slider_10,
    midShift=number_slider_11,
    overlapShift=number_slider_12,
    randomCentShift=toggle,
    seed=number_slider_3,
    minExtrude=number_slider_4,
    offsetDist=number_slider_2)  # -> out, A, B, C, D; inputs bp: Brep, edges: list of Curve, crvTree: tree of Curve, length: Double, gap: Double, offset: Double, edgeShift: Double, zShift: Double, baseTaperLength: Double, maxRan: Double, midThick: Double, midShift: Double, overlapShift: Double, randomCentShift: Boolean, seed: Int32, minExtrude: Double, offsetDist: Double; disabled
# ---------- c_create_fins: C# usings ----------
using System.Linq;
# ---------- c_create_fins: C# ----------
    DataTree<Curve>.DuplicateT dupCrv = (Curve c) => c.DuplicateCurve();
    DataTree<Curve> contourTree = new DataTree<Curve>(crvTree, dupCrv);
    DataTree<Curve> shiftedTree = new DataTree<Curve>();
    DataTree<Curve> cccTree = new DataTree<Curve>();
    DataTree<Curve> cornerTree = new DataTree<Curve>();
    ShiftCurves(edges, crvTree, edgeShift, offset, out cornerTree, out shiftedTree);
    List<Point3d> ptList = new List<Point3d>();
    List<Brep> bpList = new List<Brep>();
    List<Curve> crvChkList = new List<Curve>();
    DataTree<Curve> crvChkTree = new DataTree<Curve>();
    DataTree<Point3d> ptChkTree = new DataTree<Point3d>();
    Random rn = new Random(seed);
    List<Curve> cvJoined = new List<Curve>();
    double extrudeDist = minExtrude;
    for(int i = 0;i < crvTree.BranchCount;i++){
      Curve[] cJoinArr = Curve.JoinCurves(crvTree.Branch(i));
      cvJoined.AddRange(cJoinArr);
    }
    for(int i = 0;i < shiftedTree.BranchCount;i++){
      Curve[] cJoinArr = Curve.JoinCurves(shiftedTree.Branch(i));
      shiftedTree.Branch(i).Clear();
      shiftedTree.Branch(i).AddRange(cJoinArr);
    }
    int counter = 0;
    for(int i = 0;i < shiftedTree.BranchCount;i++){
      int index = shiftedTree.Path(i)[0];

      for(int j = 0;j < shiftedTree.Branch(i).Count;j++){
        Curve c = shiftedTree.Branch(i)[j];
        if(gap > 0){
          c = c.Trim(CurveEnd.Start, Math.Abs(gap));
        }
        else{
          c = c.Extend(CurveEnd.Start, Math.Abs(gap), CurveExtensionStyle.Smooth);
        }
        c.Domain = new Interval(0, 1);
        double cLength = c.GetLength();
        Point3d p = c.PointAtStart;
        double num = Math.Ceiling(cLength / (length + gap));
        List<Line> lns = new List<Line>();
        //lns = GetLinesOnCurveRecur(c, c.Domain.T0, newGap, length, 0);
        double[] tArr = c.DivideByCount((int) num, true);
        for(int k = 0;k < tArr.Length - 1;k++){
          Point3d ptDiv = c.PointAt(tArr[k]);
          Point3d ptDiv2 = c.PointAt(tArr[k + 1]);
          lns.Add(new Line(ptDiv, ptDiv2 - ptDiv, ptDiv2.DistanceTo(ptDiv) - gap));
        }

        cccTree.AddRange(lns.Select(x => x.ToNurbsCurve()), shiftedTree.Path(i));
        for(int k = 0;k < lns.Count;k++){
          double randomNum = rn.Next(0, 4);
          randomNum = randomNum / 3 * maxRan;
          extrudeDist = minExtrude + randomNum;
          double lnLength = lns[k].Length;
          Point3d p1 = lns[k].From;
          Point3d p2 = lns[k].To;


          Point3d ptMid = (p1 + p2) / 2;
          Curve c0 = crvTree.Branch(index - 1)[j];
          Curve c2 = crvTree.Branch(index + 1)[j];
          Plane pln1 = new Plane(p1, lns[k].UnitTangent);
          Plane pln2 = new Plane(p2, lns[k].UnitTangent);

          var cpInter01 = Rhino.Geometry.Intersect.Intersection.CurvePlane(c0, pln1, 0.01);
          var cpInter02 = Rhino.Geometry.Intersect.Intersection.CurvePlane(c0, pln2, 0.01);
          var cpInter21 = Rhino.Geometry.Intersect.Intersection.CurvePlane(c2, pln1, 0.01);
          var cpInter22 = Rhino.Geometry.Intersect.Intersection.CurvePlane(c2, pln2, 0.01);
          Point3d p01 = Point3d.Unset;
          Point3d p02 = Point3d.Unset;
          Point3d p21 = Point3d.Unset;
          Point3d p22 = Point3d.Unset;
          if(cpInter01 == null || cpInter02 == null || cpInter21 == null || cpInter22 == null){
            double tTemp;
            c0.ClosestPoint(p1, out tTemp);
            p01 = c0.PointAt(tTemp);

            c2.ClosestPoint(p1, out tTemp);
            p21 = c2.PointAt(tTemp);
            Print("hello");
          }
          else{
            p01 = cpInter01[0].PointA;
            p21 = cpInter21[0].PointA;
          }

          p22 = p21 + lns[k].UnitTangent * lnLength;
          p02 = p01 + lns[k].UnitTangent * lnLength;
          p1 = (p01 + p21 ) / 2;
          p2 = (p02 + p22 ) / 2;

          Vector3d vertGap1 = (p21 - p01) * zShift;
          Vector3d vertGap2 = (p22 - p02) * zShift;

          p01 += vertGap1;
          p02 += vertGap2;
          p21 -= vertGap1;
          p22 -= vertGap2;
          if(gap < 0)
          {
            //            p2 += norm * overlapShift;
            //            p22 += norm * overlapShift;
            //            p02 += norm * overlapShift;
          }

          Point3d pApex1 = p1;
          Point3d pApex2 = p2;
          Point3d pThick2 = Point3d.Unset;
          Point3d pThick1 = Point3d.Unset;
          double shiftCentre = midShift;
          if(randomCentShift){
            int rando = rn.Next(0, 4);
            double rRando = rando / 3.0;
            shiftCentre *= rRando;
          }


          List<Point3d> pts1 = DrawProfilePoints(pln1, p1, p01, p21, shiftCentre, midThick, 0, baseTaperLength, false);
          List<Point3d> pts2 = DrawProfilePoints(pln1, p2, p02, p22, shiftCentre, midThick, 0, baseTaperLength, false);
          Vector3d vTestHoriz1 = pts1[1] - pts1[0];
          Vector3d vTestHoriz2 = pts1[pts1.Count - 2] - pts1[pts1.Count - 1];
          vTestHoriz1.Unitize();
          vTestHoriz2.Unitize();
          double horizTest1 = vTestHoriz1 * Vector3d.ZAxis;
          double horizTest2 = vTestHoriz2 * Vector3d.ZAxis;

          Vector3d norm = Vector3d.CrossProduct(vertGap1, lns[k].UnitTangent);
          if(Math.Abs(horizTest1) < Math.Abs(horizTest2))norm = vTestHoriz1;
          else norm = vTestHoriz2;
          norm.Unitize();

          pApex1 = pts1[1];
          pApex2 = pts2[1];
          if(midThick > 0){
            pThick1 = pts1[2];
            pThick2 = pts2[2];
          }
          Line ln00 = new Line(p01 + norm * offsetDist, p02 + norm * offsetDist);
          Line ln0 = new Line(p01 + norm * extrudeDist + norm * offsetDist, p02 + norm * extrudeDist + norm * offsetDist);
          Line ln1 = new Line(pApex1 + norm * extrudeDist + norm * offsetDist, pApex2 + norm * extrudeDist + norm * offsetDist);
          Line ln12 = Line.Unset;
          Line ln2 = new Line(p21 + norm * extrudeDist + norm * offsetDist, p22 + norm * extrudeDist + norm * offsetDist);
          Line ln22 = new Line(p21 + norm * offsetDist, p22 + norm * offsetDist);

          if(midThick > 0){
            ln12 = new Line(pThick1 + norm * extrudeDist + norm * offsetDist, pThick2 + norm * extrudeDist + norm * offsetDist);
          }

          List<Curve> cvForBrep = new List<Curve>();
          cvForBrep.Add(ln0.ToNurbsCurve());
          cvForBrep.Add(ln1.ToNurbsCurve());
          if(ln12 != Line.Unset){
            cvForBrep.Add(ln12.ToNurbsCurve());
          }
          cvForBrep.Add(ln2.ToNurbsCurve());

          if(extrudeDist > 0){
            cvForBrep.Insert(0, ln00.ToNurbsCurve());
            cvForBrep.Add(ln22.ToNurbsCurve());
          }
          Brep[] bpArr = Brep.CreateFromLoft(cvForBrep, Point3d.Unset, Point3d.Unset, LoftType.Straight, true);

          if(gap < 0){
            Transform txRot = new Transform(1);
            txRot *= Transform.Rotation(Math.PI / 2 * overlapShift, Vector3d.ZAxis, p21);
            bpArr[0].Transform(txRot);
          }
          bpList.AddRange(bpArr);

          crvChkTree.AddRange(cvForBrep,new GH_Path(counter));
          counter++;
        }
      }
    }
    for(int i = 0;i < cornerTree.BranchCount;i++){
      int index = cornerTree.Path(i)[0];
      Curve[] cJoined = Curve.JoinCurves(cornerTree.Branch(i));
      for(int j = 0;j < cJoined.Length;j++){
        double randomNum = rn.Next(0, 4);
        randomNum = randomNum / 3 * maxRan;
        extrudeDist = minExtrude + randomNum;
        double shiftCentre = midShift;
        if(randomCentShift){
          int rando = rn.Next(0, 4);
          double rRando = rando / 3.0;
          shiftCentre *= rRando;
        }
        Curve c = cJoined[j];
        Curve[] cExplo = c.DuplicateSegments();
        if(cExplo.Length == 0)cExplo = new Curve[1]{c};
        List<Point3d> ptListExplo = new List<Point3d>();
        ptListExplo.AddRange(cExplo.Select(x => x.PointAtStart));
        ptListExplo.Add(c.PointAtEnd);
        List<Point3d> pConstruct00 = new List<Point3d>();
        List<Point3d> pConstruct0 = new List<Point3d>();
        List<Point3d> pConstruct1 = new List<Point3d>();
        List<Point3d> pConstruct12 = new List<Point3d>();
        List<Point3d> pConstruct2 = new List<Point3d>();
        List<Point3d> pConstruct22 = new List<Point3d>();
        Point3d centreRot = ptListExplo.Last();
        for(int k = 0;k < ptListExplo.Count;k++){

          ptChkTree.Add(ptListExplo[k], new GH_Path(index));
          if(k == 0 || k == ptListExplo.Count - 1){
            Point3d pExplo = ptListExplo[k];
            Vector3d gapShift = new Vector3d(0, 0, 0);

            gapShift.Unitize();
            gapShift *= gap;
            Vector3d norm;
            ComponentIndex ci;
            Point3d cp;
            double s;
            double ttt;
            bp.ClosestPoint(pExplo, out cp, out ci, out s, out ttt, 1, out norm);
            norm.Unitize();
            Plane pln1 = Plane.Unset;
            if(k == 0){
              pln1 = new Plane(pExplo, ptListExplo[k + 1] - ptListExplo[k]);
            }
            else{
              pln1 = new Plane(pExplo, ptListExplo[k] - ptListExplo[k - 1]);
            }

            Point3d p1 = pExplo;

            double chkDist = double.MaxValue;
            int indexOfCrv = -1;
            for(int u = 0;u < crvTree.Branch(index - 1).Count;u++){
              Curve cTest = crvTree.Branch(index)[u];
              double tTest;
              cTest.ClosestPoint(p1, out tTest);
              double chkDistCompare = p1.DistanceTo(cTest.PointAt(tTest));
              if(chkDist > chkDistCompare){
                chkDist = chkDistCompare;
                indexOfCrv = u;
              }
            }

            Curve c0 = crvTree.Branch(index - 1)[indexOfCrv].DuplicateCurve();
            Curve c2 = crvTree.Branch(index + 1)[indexOfCrv].DuplicateCurve();
            c0 = c0.Extend(CurveEnd.Both, 5, CurveExtensionStyle.Line);
            c2 = c2.Extend(CurveEnd.Both, 5, CurveExtensionStyle.Line);
            var cpInter01 = Rhino.Geometry.Intersect.Intersection.CurvePlane(c0, pln1, 0.01);
            var cpInter21 = Rhino.Geometry.Intersect.Intersection.CurvePlane(c2, pln1, 0.01);
            Point3d p01 = Point3d.Unset;
            Point3d p02 = Point3d.Unset;
            Point3d p21 = Point3d.Unset;
            Point3d p22 = Point3d.Unset;
            if(cpInter01 == null || cpInter21 == null ){
              double tTemp;
              c0.ClosestPoint(p1, out tTemp);
              p01 = c0.PointAt(tTemp);

              c2.ClosestPoint(p1, out tTemp);
              p21 = c2.PointAt(tTemp);
            }
            else{
              p01 = cpInter01[0].PointA;
              p21 = cpInter21[0].PointA;
            }

            p1 = (p01 + p21) / 2;
            Vector3d vertGap1 = (p21 - p01) * zShift;
            p01 += vertGap1;
            p21 -= vertGap1;
            Point3d pApex = p1;
            Point3d pApex12 = p1;

            norm.Unitize();
            norm.Z = 0;
            norm.Unitize();
            List<Point3d> ptListGen = DrawProfilePoints(pln1, pApex, p01, p21, shiftCentre, midThick, 0, baseTaperLength, false);

            Vector3d vTestHoriz1 = ptListGen[1] - ptListGen[0];
            Vector3d vTestHoriz2 = ptListGen[ptListGen.Count - 2] - ptListGen[ptListGen.Count - 1];
            vTestHoriz1.Unitize();
            vTestHoriz2.Unitize();
            double horizTest1 = vTestHoriz1 * Vector3d.ZAxis;
            double horizTest2 = vTestHoriz2 * Vector3d.ZAxis;

            Vector3d vNorm = new Vector3d(norm);
            if(Math.Abs(horizTest1) < Math.Abs(horizTest2))vNorm = vTestHoriz1;
            else vNorm = vTestHoriz2;
            vNorm.Unitize();

            pApex = ptListGen[1];
            if(midThick > 0)pApex12 = ptListGen[2];

            if(gap < 0){
              Transform txRot = new Transform(1);
              if(k == 0){
                centreRot = ptListExplo[k + 1];
                txRot *= Transform.Rotation(Math.PI / 2 * overlapShift, Vector3d.ZAxis, centreRot);
                p01.Transform(txRot);
                pApex.Transform(txRot);
                p21.Transform(txRot);
                //                p01 += norm * Math.Abs(overlapShift);
                //                pApex += norm * Math.Abs(overlapShift);
                //                p21 += norm * Math.Abs(overlapShift);
              }
            }

            pConstruct00.Add(p01 + vNorm * offsetDist);
            pConstruct0.Add(p01 + vNorm * extrudeDist + vNorm * offsetDist);
            pConstruct1.Add(pApex + vNorm * extrudeDist + vNorm * offsetDist);
            pConstruct12.Add(pApex12 + vNorm * extrudeDist + vNorm * offsetDist);
            pConstruct2.Add(p21 + vNorm * extrudeDist + vNorm * offsetDist);
            pConstruct22.Add(p21 + vNorm * offsetDist);
            continue;
          }
          else{
            Point3d p0 = ptListExplo[k - 1];
            Point3d p2 = ptListExplo[k + 1];
            Vector3d norm0;
            ComponentIndex ci0;
            Point3d cp0;
            double s0;
            double ttt0;
            bp.ClosestPoint(p0, out cp0, out ci0, out s0, out ttt0, 1, out norm0);

            Vector3d norm2;
            ComponentIndex ci2;
            Point3d cp2;
            double s2;
            double ttt2;
            bp.ClosestPoint(p2, out cp2, out ci2, out s2, out ttt2, 1, out norm2);

            norm0.Unitize();
            norm2.Unitize();

            Vector3d normCorner = norm2 + norm0;
            Point3d ptCorner = ptListExplo[k];
            Plane cornerPlane = new Plane(ptCorner, p0 - ptCorner, p2 - ptCorner);
            double angleCorner = Vector3d.VectorAngle(p0 - ptCorner, p2 - ptCorner, cornerPlane);
            if(angleCorner > Math.PI)angleCorner = Math.PI * 2 - angleCorner;
            angleCorner /= 2;
            double cornerMultiplier = 1;
            if(angleCorner != 0 || angleCorner != Math.PI){
              cornerMultiplier = 1 / Math.Sin(angleCorner);
            }

            // cornerPlane = new Plane(ptCorner, Vector3d.CrossProduct(norm0, norm2));
            normCorner.Unitize();
            normCorner *= cornerMultiplier;
            double chkDist = double.MaxValue;
            int indexOfCrv = -1;
            for(int u = 0;u < crvTree.Branch(index - 1).Count;u++){
              Curve cTest = crvTree.Branch(index)[u];
              double tTest;
              cTest.ClosestPoint(p0, out tTest);
              double chkDistCompare = p0.DistanceTo(cTest.PointAt(tTest));
              if(chkDist > chkDistCompare){
                chkDist = chkDistCompare;
                indexOfCrv = u;
              }
            }

            Curve c0 = crvTree.Branch(index - 1)[indexOfCrv];
            Curve c2 = crvTree.Branch(index + 1)[indexOfCrv];
            Point3d p01 = c0.PointAtEnd;
            Point3d p21 = c2.PointAtEnd;

            ptCorner = (p01 + p21) / 2;
            Vector3d vertGap1 = (p21 - p01) * zShift;
            p01 += vertGap1;
            p21 -= vertGap1;
            Point3d pApex = ptCorner;
            Point3d pApex12 = ptCorner;

            double cLength = normCorner.Length;
            normCorner.Unitize();
            normCorner *= cLength;
            //
            //              Print(pApex.ToString());
            //              Print(normCorner.ToString());
            Vector3d vvNorm = Vector3d.CrossProduct(p01 - p21, normCorner);
            //vvNorm = (p2 - ptListExplo[k]) / p2.DistanceTo(ptListExplo[k]) + (ptListExplo[k] - p0) / p0.DistanceTo(ptListExplo[k]);
            Plane pln1 = new Plane(pApex, vvNorm);
            Vector3d norm = new Vector3d(normCorner);
            List<Point3d> ptListGen = DrawProfilePoints(pln1, pApex, p01, p21, shiftCentre, midThick, 0, baseTaperLength * cLength, false);

            Vector3d vTestHoriz1 = ptListGen[1] - ptListGen[0];
            Vector3d vTestHoriz2 = ptListGen[ptListGen.Count - 2] - ptListGen[ptListGen.Count - 1];
            vTestHoriz1.Unitize();
            vTestHoriz2.Unitize();
            double horizTest1 = vTestHoriz1 * Vector3d.ZAxis;
            double horizTest2 = vTestHoriz2 * Vector3d.ZAxis;

            Vector3d vNorm = new Vector3d(normCorner);
            if(Math.Abs(horizTest1) < Math.Abs(horizTest2))vNorm = vTestHoriz1;
            else vNorm = vTestHoriz2;
            vNorm.Unitize();


            pApex = ptListGen[1];
            if(midThick > 0)pApex12 = ptListGen[2];

            if(gap < 0){
              centreRot = ptListExplo[k + 1];
              Transform txRot = new Transform(1);
              txRot *= Transform.Rotation(Math.PI / 2 * overlapShift, Vector3d.ZAxis, centreRot);
              p01.Transform(txRot);
              pApex.Transform(txRot);
              p21.Transform(txRot);
            }
            pConstruct00.Add(p01 + vNorm * offsetDist);
            pConstruct0.Add(p01 + vNorm * extrudeDist + vNorm * offsetDist);
            pConstruct1.Add(pApex + vNorm * extrudeDist + vNorm * offsetDist);
            pConstruct12.Add(pApex12 + vNorm * extrudeDist + vNorm * offsetDist);
            pConstruct2.Add(p21 + vNorm * extrudeDist + vNorm * offsetDist);
            pConstruct22.Add(p21 + vNorm * offsetDist);
          }
        }
        var pline00 = new Polyline(pConstruct00);
        var pline0 = new Polyline(pConstruct0);
        var pline1 = new Polyline(pConstruct1);
        var pline12 = new Polyline(pConstruct12);
        var pline2 = new Polyline(pConstruct2);
        var pline22 = new Polyline(pConstruct22);
        List<Curve> cvForBrep = new List<Curve>();
        cvForBrep.Add(pline0.ToNurbsCurve());
        cvForBrep.Add(pline1.ToNurbsCurve());
        if(midThick > 0 ){
          cvForBrep.Add(pline12.ToNurbsCurve());
        }
        cvForBrep.Add(pline2.ToNurbsCurve());
        if(extrudeDist > 0){
          cvForBrep.Insert(0, pline00.ToNurbsCurve());
          cvForBrep.Add(pline22.ToNurbsCurve());
        }
        Brep[] bpArr = Brep.CreateFromLoft(cvForBrep, Point3d.Unset, Point3d.Unset, LoftType.Straight, true);

        var path = new GH_Path(index);
        bpList.AddRange(bpArr);
        crvChkTree.AddRange(cvForBrep, new GH_Path(counter));
        counter++;
      }
    }
    A = cccTree;
    B = cornerTree;
    C = bpList;
    D = crvChkTree;
# ---------- c_create_fins: C# additional code ----------
  List<Line>GetLinesOnCurveRecur(Curve cv, double t, double gap, double length, int counter){
    List<Line> outputLine = new List<Line>();
    if(counter > 200){
      return outputLine;
    }
    counter++;
    Point3d p = cv.PointAt(t);
    //Brep sph = new Sphere(p, length + gap).ToBrep();
    Brep sph = new Sphere(p, length).ToBrep();
    if(gap <= 0){
      sph = new Sphere(p, length + gap).ToBrep();
    }
    Curve[] cvOverlap;
    Point3d[] ptInter;
    Rhino.Geometry.Intersect.Intersection.CurveBrep(cv, sph, 0.01, out cvOverlap, out ptInter);
    Point3d nextPt = Point3d.Unset;
    double tNext;
    if(ptInter.Length == 1){
      double tt;
      cv.ClosestPoint(ptInter[0], out tt);
      if(tt < t)return outputLine;
      nextPt = ptInter[0];
      tNext = tt;
    }
    else{
      double ttMax = double.MinValue;
      for(int i = 0;i < ptInter.Length;i++){
        double tt;
        cv.ClosestPoint(ptInter[i], out tt);
        if(ttMax < tt){
          ttMax = tt;
        }
      }
      nextPt = cv.PointAt(ttMax);
      tNext = ttMax;
    }
    Curve[] cSplitArr = cv.Split(tNext);
    if(cSplitArr == null)return outputLine;
    if(cSplitArr.Length == 0)return outputLine;
    Line ln = new Line(p, nextPt - p, length);
    if(gap > 0){
      cv.LengthParameter(cSplitArr[0].GetLength() + gap, out tNext);
    }
    outputLine.Add(ln);
    outputLine.AddRange(GetLinesOnCurveRecur(cv, tNext, gap, length, counter));
    return outputLine;
  }

  List<Point3d>DrawProfilePoints(Plane pln, Point3d p1, Point3d p0, Point3d p2, double midShift,
  double midThick, double zShift, double baseTaperLength, bool onlyHoriz){
    List<Point3d> ptOutput = new List<Point3d>();
    Vector3d vertGap1 = (p2 - p0) * zShift;

    p0 += vertGap1;
    p2 -= vertGap1;

    Point3d pApex1 = p1;
    double shiftCentre = midShift;
    vertGap1 = (p2 - p0);
    vertGap1.Unitize();
    Vector3d vNorm1 = Vector3d.CrossProduct(vertGap1, pln.ZAxis);

    //    Print(p1.ToString());
    //    Print(vNorm1.ToString());
    //    Print(pln.ZAxis.ToString());
    vNorm1.Unitize();
    pApex1 = p0 + vNorm1 * baseTaperLength;
    Vector3d vv1 = pApex1 - p1;
    double lLength1 = vv1.Length;
    double dLength1 = p0.DistanceTo(p1);
    double dLength2 = p2.DistanceTo(p1);
    double angleA1 = Math.PI / 2 - Vector3d.VectorAngle(vNorm1, Vector3d.ZAxis, pln);
    double angleA2 = Vector3d.VectorAngle(vertGap1 * -1, Vector3d.ZAxis, pln) - Math.PI / 2;

    if(Math.Abs(angleA1) > Math.PI)angleA1 = Math.PI * 2 - Math.Abs(angleA1);
    if(Math.Abs(angleA2) > Math.PI)angleA2 = Math.PI * 2 - Math.Abs(angleA2);

    double angleRot1 = Math.PI / 2 - Math.Asin(dLength1 * Math.Sin(angleA1 + Math.PI / 2) / lLength1) - angleA1;
    double origAngle = Math.PI - Vector3d.VectorAngle(vv1, vertGap1, pln);
    double angleRot2 = Math.Asin(dLength2 * Math.Sin(angleA2) / lLength1) + angleA2 - origAngle;

    angleRot1 -= origAngle;
    angleRot1 *= -1;
    vv1.Unitize();
    double otherAngle = Math.PI / 2 - origAngle;
    otherAngle *= -1;
    angleRot2 *= -1;
    double angleRotMin1 = angleRot1;
    double maxAngle = angleRot2;
    if(otherAngle < angleRot2)maxAngle = otherAngle;
    if(onlyHoriz)maxAngle = angleRot2;
    double diff = maxAngle - angleRotMin1;
    if(maxAngle > angleRotMin1){
      //maxAngle = Math.PI * 2 - maxAngle;
      //diff = angleRotMin1 - maxAngle;
      Print(maxAngle.ToString());
      Print(angleRotMin1.ToString());
    }
    else{

    }
    double aAngle = (diff) *shiftCentre + angleRotMin1;
    Vector3d vvY1 = lLength1 * Math.Sin(aAngle) * Vector3d.CrossProduct(vv1, pln.ZAxis);
    Vector3d vvX1 = lLength1 * Math.Cos(aAngle) * vv1;
    pApex1 = new Point3d(vvX1 + vvY1 + p1);

    Vector3d vvY1Base = lLength1 * Math.Sin(angleRotMin1) * Vector3d.CrossProduct(vv1, pln.ZAxis);
    Vector3d vvX1Base = lLength1 * Math.Cos(angleRotMin1) * vv1;
    Point3d pBase = new Point3d(vvX1Base + vvY1Base + p1);
    ptOutput.Add(p0);
    ptOutput.Add(pApex1);
    if(midThick > 0){
      Point3d p12 = pBase;
      vertGap1.Unitize();
      Vector3d thickShift = Vector3d.CrossProduct(pln.ZAxis, pApex1 - p0);
      thickShift.Unitize();
      p12 = pApex1 + thickShift * midThick;
      //      double lLength12 = p12.DistanceTo(p1);
      //      Vector3d vv12 = p12 - p1;
      //      vv12.Unitize();
      //      //Vector3d vvY12 = lLength12 * Math.Sin(aAngle) * Vector3d.CrossProduct(vv12, pln.ZAxis);
      //      //Vector3d vvX12 = lLength12 * Math.Cos(aAngle) * vv12;
      //      Transform tx = new Transform(1);
      //      tx *= Transform.Rotation(aAngle - angleRotMin1, -1 * pln.ZAxis, p1);
      //      p12.Transform(tx);
      //p12 = new Point3d(vvX12 + vvY12 + p1);
      ptOutput.Add(p12);
    }
    ptOutput.Add(p2);

    return ptOutput;

  }

  bool ShiftCurves(List<Curve> edges, DataTree<Curve> crvTree, double edgeShift, double offset, out DataTree<Curve>Corner, out DataTree<Curve>Shifted){
    DataTree<Curve>.DuplicateT dupCrv = (Curve c) => c.DuplicateCurve();
    DataTree<Curve> contourTree = new DataTree<Curve>(crvTree, dupCrv);
    DataTree<Curve> shiftedTree = new DataTree<Curve>();
    DataTree<Curve> cornerTree = new DataTree<Curve>();
    for(int i = 0;i < contourTree.BranchCount;i++){
      if(i % 2 == 0)continue;
      var path = contourTree.Path(i);
      for(int j = 0;j < contourTree.Branch(i).Count;j++){
        Curve c = contourTree.Branch(i)[j];
        var p1 = c.PointAtStart;
        var p2 = c.PointAtEnd;
        double cornerShift = edgeShift;
        if(i % 4 == 1)cornerShift += offset;
        for(int k = 0;k < edges.Count;k++){
          double t;
          edges[k].ClosestPoint(p1, out t);
          Point3d ep1 = edges[k].PointAt(t);
          edges[k].ClosestPoint(p2, out t);
          Point3d ep2 = edges[k].PointAt(t);
          double d1 = ep1.DistanceTo(p1);
          double d2 = ep2.DistanceTo(p2);
          if(d1 < 0.1){
            double tt;
            c.LengthParameter(cornerShift, out tt);
            Curve[] cArr = c.Split(tt);
            c = cArr[1];
            cornerTree.Add(cArr[0], path);
          }
          else if(d2 < 0.1){
            double tt;
            c.LengthParameter(c.GetLength() - cornerShift, out tt);
            Curve[] cArr = c.Split(tt);
            c = cArr[0];
            cornerTree.Add(cArr[1], path);
          }

        }
        shiftedTree.Add(c, path);
      }
    }
    Shifted = shiftedTree;
    Corner = cornerTree;
    return true;
  }
# ---------- end c_create_fins ----------
number_slider_19 = Slider(0, range=-100..100)
number_slider_20 = Slider(20, range=0..100)
point_2 = Point(evaluate_curve_2.Point)
line = Line(StartPoint=point_2, EndPoint=point)
boolean_toggle = BooleanToggle(True)
camera = Camera(on=boolean_toggle, CameraLocation=point_2, CameraTarget=point, len=number_slider_20, bias=number_slider_19)  # -> out, A; inputs on: Boolean, CameraLocation: Point3d, CameraTarget: Point3d, len: Double, bias: Double, shoot: Boolean, file: String
# ---------- camera: C# usings ----------
using System.Drawing;
# ---------- camera: C# ----------
    Point3d cL = CameraLocation;
    Point3d cT = CameraTarget;
    if(on)
    {
      Rhino.Display.RhinoViewport v = doc.Views.ActiveView.ActiveViewport;

      //v.ChangeToParallelProjection(true);
      // v.ChangeToParallelProjection(true);
      v.ChangeToPerspectiveProjection(true, len);
      v.SetCameraLocation(cL, false);
      Vector3d vec = cT - cL;
      v.SetCameraDirection(vec, false);
      v.Camera35mmLensLength = len;
      v.Rotate(bias / 180 * Math.PI, v.CameraZ, v.CameraLocation);
      //Vector3d cz = v.CameraZ;
      //A = cz;
      if(shoot)
      {
        Size ss = new Size(1920, 1080);
        Rhino.RhinoDoc.ActiveDoc.Views.ActiveView.CaptureToBitmap(ss).Save(file);
      }
      A = v.GetNearRect();
    }
# ---------- end camera ----------
camera_2 = Camera(on=boolean_toggle, CameraLocation=point_2, CameraTarget=point, len=number_slider_20, bias=number_slider_19)  # -> out, A; inputs on: Boolean, CameraLocation: Point3d, CameraTarget: Point3d, len: Double, bias: Double, shoot: Boolean, file: String; disabled
# ---------- camera_2: C# ----------
    Point3d cL = CameraLocation;
    Point3d cT = CameraTarget;
    if(on)
    {
      Rhino.Display.RhinoViewport v = doc.Views.ActiveView.ActiveViewport;
      v.SetCameraLocation(cL, false);
      Vector3d vec = cT - cL;
      v.SetCameraDirection(vec, false);
      v.Camera35mmLensLength = len;
      v.Rotate(bias / 180 * Math.PI, v.CameraZ, v.CameraLocation);
      //Vector3d cz = v.CameraZ;
      //A = cz;
      if(shoot)
      {
        Size ss = new Size(1920, 1080);
        Rhino.RhinoDoc.ActiveDoc.Views.ActiveView.CaptureToBitmap(ss).Save(file);
      }
      A = v.GetNearRect();
    }
# ---------- end camera_2 ----------
brep = Brep(c_create_fins.C)  # disabled
item_6 = ListItem(List=camera.A, Index=0, Wrap=True)  # -> Item, Item1, Item2, Item3
edges = BrepEdges(Brep=brep)  # -> Naked, Interior, NonManifold; disabled
crv_8 = Curve(c_create_fins.A)  # disabled
crv_9 = Curve(c_create_fins.B)  # disabled
rec_3pt = Rectangle3Pt(PointA=item_6.Item, PointB=item_6.Item1, PointC=item_6.Item2)  # -> Rectangle, Length
loft_2 = Loft(Curves=c_create_fins.D, Options={Adjust=False, Closed=True, LoftEnds=0, LoftSimp=0, LoftType=3, Rebuild=10, Refit=0.01})  # disabled
srf = Surface(simplify(edges.Naked))  # disabled
loft_3 = Loft(Options={Adjust=False, Closed=False, LoftEnds=0, LoftSimp=0, LoftType=0, Rebuild=10, Refit=0.01})  # disabled
merge = Merge(Data1=simplify(graft(loft_2)), Data2=srf)  # disabled
pl = ConstructPlane(Origin=Point(0, 0, 0), XAxis=Vector(1, 0, 0), YAxis=Vector(0, 1, 0))
brep_2 = Brep(graft([<brep referenced from the Rhino model> x264]))

# ----
# Back panel Output
loft_4 = Loft(Curves=crv, Options={Adjust=False, Closed=False, LoftEnds=0, LoftSimp=0, LoftType=0, Rebuild=10, Refit=0.01})  # disabled

edges_2 = BrepEdges(Brep=brep_2)  # -> Naked, Interior, NonManifold

# ----
# fin output
join_2 = BrepJoin(Breps=merge)  # -> Breps, Closed; disabled

item_7 = ListItem(List=edges_2.Interior, Index=0, Wrap=True)
brep_3 = Brep(brep_2)
volume = Volume(Geometry=brep_3)  # -> Volume, Centroid
end = EndPoints(Curve=item_7)  # -> Start, End
len = Length(Curve=item_7)
number_slider_21 = Slider(1000, range=0..1000)
swatch = ColourSwatch(SwatchColor=RGB(66, 66, 66))  # disabled
pdecon = Deconstruct(Point=point)  # -> XComponent, YComponent, ZComponent
pdecon_2 = Deconstruct(Point=end.Start)  # -> XComponent, YComponent, ZComponent
pdecon_3 = Deconstruct(Point=volume.Centroid)  # -> XComponent, YComponent, ZComponent
bnd = Bounds(Numbers=flatten(len))
bnd_2 = Bounds(Numbers=flatten(pdecon_2.ZComponent))
preview = CustomPreview(Geometry=loft_4, Material=swatch)  # disabled
edges_3 = BrepEdges(Brep=join_2.Breps)  # -> Naked, Interior, NonManifold; disabled
pt_3 = ConstructPoint(XCoordinate=pdecon.XComponent, YCoordinate=pdecon.YComponent, ZCoordinate=0)
pt_4 = ConstructPoint(XCoordinate=pdecon_3.XComponent, YCoordinate=pdecon_3.YComponent, ZCoordinate=0)
dist = Distance(PointA=pt_3, PointB=pt_4)
panel_5 = Panel(bnd_2)
smaller = SmallerThan(FirstNumber=dist, SecondNumber=Slider(13346, range=0..100000))  # -> SmallerThan, OrEqualTo
debrep_2 = DeconstructBrep(Brep=brep_3)  # -> Faces, Edges, simplify(Vertices)
swatch_2 = ColourSwatch(SwatchColor=RGB(66, 66, 66))  # disabled
number_slider_22 = Slider(100000, range=0..100000)
preview_2 = CustomPreview(Geometry=flatten(join_2.Breps), Material=ColourSwatch(SwatchColor=RGB(214, 214, 214)))  # disabled
dup = DuplicateDataMatch(SourceDataTree=debrep_2.Vertices, SecondaryData1=smaller.OrEqualTo)  # -> SourceData, SecondaryData1
preview_3 = CustomPreview(Geometry=[edges_3.Naked, edges_3.Interior, edges_3.NonManifold], Material=swatch_2)  # disabled
dup_2 = DuplicateDataMatch(SourceDataTree=debrep_2.Edges, SecondaryData1=smaller.OrEqualTo)  # -> SourceData, SecondaryData1
avr = Average(Input=[item_6.Item, item_6.Item1])
avr_2 = Average(Input=[item_6.Item2, item_6.Item3])
pln = Plane(rec_3pt.Rectangle)
cull = CullPattern(List=debrep_2.Vertices, CullPattern=dup.SecondaryData1)  # -> simplify(List)
cull_2 = CullPattern(List=debrep_2.Edges, CullPattern=dup_2.SecondaryData1)  # -> simplify(List)
division = Division(A=number_slider_22, B=2)
cull_3 = CullPattern(List=brep_3, CullPattern=smaller.OrEqualTo)  # disabled
vec2pt = Vector2Pt(PointA=avr, PointB=avr_2, Unitize=True)  # -> Vector, Length
cull_4 = CullPattern(List=volume.Centroid, CullPattern=smaller.OrEqualTo)  # disabled
project = Project(Geometry=cull_2, Plane=pln)  # -> simplify(Geometry), Transform
multiplication = Multiplication(A=vec2pt.Vector, B=division)
number_slider_23 = Slider(0.0001, range=0..0.0001)  # disabled
debrep_3 = DeconstructBrep(Brep=cull_3)  # -> Faces, Edges, simplify(Vertices); disabled
subtraction_2 = Subtraction(A=avr, B=multiplication)
line_2 = LineSDL(Start=subtraction_2, Direction=vec2pt.Vector, Length=number_slider_22)
crvprox = CurveProximity(CurveA=project.Geometry, CurveB=line_2)  # -> PointA, PointB, simplify(Distance); disabled
c_script = CSharpScript(x=crvprox.Distance, y=number_slider_23)  # -> out, A; inputs x: list of Double, y: Double; disabled
# ---------- c_script: C# ----------
    bool output = true;
    Print(x[0].ToString());
    if(x.Count == 1){
      output = false;
      A = output;
      return;
    }
    
    var orderedList = x.OrderBy(e => e);
    double min = orderedList.First();
    if(min > y)output = false;
    A = output;
# ---------- end c_script ----------
c_script_2 = CSharpScript(crv=project.Geometry, pln=pln)  # -> out, simplify(A), B; inputs crv: list of Curve, pln: Plane
# ---------- c_script_2: C# ----------
    Transform tx = new Transform(1);
    tx *= Transform.ChangeBasis(Plane.WorldXY, pln);

    bool output = false;
    List<Point3d> ptList = new List<Point3d>();
    for(int i = 0;i < crv.Count;i++){
      if(crv[i] == null)continue;
      Point3d p0 = crv[i].PointAtStart;
      Point3d p1 = crv[i].PointAtEnd;
      p0.Transform(tx);
      p1.Transform(tx);

      if (p0.X * p1.X < 0){
        output = true;
        break;
      }
    }
    A = output;
    B = ptList;
# ---------- end c_script_2 ----------
dom_2 = ConstructDomain(DomainStart=Slider(0, range=0..10), DomainEnd=Slider(80, range=0..120))
cull_5 = CullPattern(List=brep_3, CullPattern=c_script_2.A)  # -> simplify(List)
c_script_3 = CSharpScript(
    bTree=brep_3,
    boolList=flatten(c_script_2.A),
    reset=button,
    srcDomain=bnd,
    targetDomain=dom_2,
    Reference=["C:\Users\yongsiang\Desktop\Work\Sound\Rug.Osc 1.2.4.0\Rug.Osc.dll", "C:\Users\yongsiang\Desktop\Work\Sound\Latest\v0.1.1.0\Release\SharpOSC.dll"])  # -> out, A; inputs bTree: tree of Brep, boolList: list of Boolean, reset: Boolean
# ---------- c_script_3: C# usings ----------
using SharpOSC;
using System.Linq;
# ---------- c_script_3: C# ----------
    int port = 9901;
    double maxZ = 250;
    double remapZVary = 10;
    var sender = new SharpOSC.UDPSender("127.0.0.1", port);

    if (reset){
      for(int i = 0;i < bTree.BranchCount;i++){
        if(prevList[i]){
          Brep bp = bTree.Branch(i)[0];
          Curve c = bp.Edges[0].EdgeCurve;
          Point3d pt = c.PointAtStart;
          int variationZ = (int) ( pt.Z / maxZ * remapZVary);
          int pit = (int) Math.Round(targetDomain.ParameterAt(srcDomain.NormalizedParameterAt(c.GetLength())), 0) + variationZ;
          EmitOSCMessage(sender, "/data/off", pit);
        }
      }
      prevList = Enumerable.Repeat(false, bTree.BranchCount).ToList();

    }

    //    var message = new SharpOSC.OscMessage("/key/", x);

    for (int i = 0;i < bTree.BranchCount;i++){
      if(prevList.Count == 0)break;

      if(boolList[i] != prevList[i]){
        Brep bp = bTree.Branch(i)[0];
        Curve c = bp.Edges[0].EdgeCurve;
        Point3d pt = c.PointAtStart;
        int variationZ = (int)( pt.Z /maxZ * remapZVary);
        int pit = (int) Math.Round(targetDomain.ParameterAt(srcDomain.NormalizedParameterAt(c.GetLength())), 0) + variationZ;
        //case of trigger either note on or note off
        if(boolList[i]){
          //trigger on case
          EmitOSCMessage(sender, "/data/on", pit);
        }
        else{
          EmitOSCMessage(sender, "/data/off", pit);
          //trigger off case
        }
      }

    }
    prevList = boolList;
    A = prevList;
    //    sender.Send(message);
    //    sender.Send(new SharpOSC.OscMessage("/key/test/", y));
# ---------- c_script_3: C# additional code ----------
  List<bool>prevList = new List<bool>();
  void EmitOSCMessage(UDPSender sender, string address, int pit){
    var message = new SharpOSC.OscMessage(address, pit);
    sender.Send(message);
  }
# ---------- end c_script_3 ----------
cull_6 = CullPattern(List=brep_3, CullPattern=graft(c_script_3.A))  # -> simplify(List)
panel_6 = Panel(c_script_3.A)
c_script_4 = CSharpScript(
    x=Slider(1, range=0..1),
    y=Slider(1, range=0..1),
    Reference=["C:\Users\yongsiang\Desktop\Work\Sound\Rug.Osc 1.2.4.0\Rug.Osc.dll", "C:\Users\yongsiang\Desktop\Work\Sound\Latest\v0.1.1.0\Release\SharpOSC.dll"])  # -> out, A
# ---------- c_script_4: C# usings ----------
using SharpOSC;
# ---------- c_script_4: C# ----------
    var message = new SharpOSC.OscMessage("/key/", x);
    var sender = new SharpOSC.UDPSender("127.0.0.1", 9001);
    sender.Send(message);
    sender.Send(new SharpOSC.OscMessage("/key/test/", y));
# ---------- end c_script_4 ----------
c_script_5 = CSharpScript(
    x=Slider(1, range=0..1),
    y=Slider(0.61, range=0..1),
    z=Slider(1, range=0..1),
    u=Slider(0.5, range=0..1),
    l=Slider(0.02, range=0..1),
    r=Slider(0.02, range=0..1),
    Reference=["C:\Users\yongsiang\Desktop\Work\Sound\Rug.Osc 1.2.4.0\Rug.Osc.dll", "C:\Users\yongsiang\Desktop\Work\Sound\Latest\v0.1.1.0\Release\SharpOSC.dll"])  # -> out, A
# ---------- c_script_5: C# ----------
    var message = new SharpOSC.OscMessage("/density", x);
    var sender = new SharpOSC.UDPSender("127.0.0.1", 9000);
    sender.Send(message);
    sender.Send(new SharpOSC.OscMessage("/position", y));
    sender.Send(new SharpOSC.OscMessage("/pitch_rand", z));
    sender.Send(new SharpOSC.OscMessage("/duration", u));
    sender.Send(new SharpOSC.OscMessage("/leftChannel", l));
    sender.Send(new SharpOSC.OscMessage("/rightChannel", r));
# ---------- end c_script_5 ----------
